# Grasshopper definition cubicframe_milling.gh (Grasshopper 1.0.7)
# plug-ins: Kangaroo Components, Kangaroo2 Components

# ---- group: kangaroo
# Kangaroo
number_slider = Slider(0.89, range=0..10)
polygon = Polygon(Plane=PlaneXY(0, 0, 0), Radius=number_slider, Segments=Slider(3, range=0..10), FilletRadius=0)  # -> Polygon, Length
Z = UnitZ(Factor=Slider(2.23, range=0..10))
move = Move(Geometry=polygon.Polygon, Motion=Z)  # -> Geometry, Transform
cp = ControlPoints(Curve=polygon.Polygon)  # -> Points, Weights, Knots
cp_2 = ControlPoints(Curve=move.Geometry)  # -> Points, Weights, Knots
duppt = RemoveDuplicatePts(Points=cp_2.Points, Tolerance=0.01)
duppt_2 = RemoveDuplicatePts(Points=cp.Points, Tolerance=0.01)
shift = ShiftList(List=duppt, Shift=1, Wrap=True)
explode = Explode(Curve=move.Geometry, Recursive=True)  # -> Segments, Vertices
explode_2 = Explode(Curve=polygon.Polygon, Recursive=True)  # -> Segments, Vertices
ln = Line(StartPoint=duppt_2, EndPoint=duppt)
ln_2 = Line(StartPoint=duppt_2, EndPoint=shift)
merge = Merge(Data1=ln, Data2=explode_2.Segments, Data3=explode.Segments)  # -> flatten(Result)
merge_2 = Merge(Data1=flatten(polygon.Polygon), Data2=flatten(move.Geometry), Data3=flatten(ln), Data4=flatten(ln_2))
len = Length(Curve=merge)
multiplication = Multiplication(A=len, B=Slider(0.582, range=0..1))
length_line = LengthLine(Line=merge, Length=multiplication, Strength=10)
length_line_2 = LengthLine(Line=ln_2, Length=ln_2, Strength=Slider(1000, range=0..1000))
show = Show(G=merge_2)
merge_3 = Merge(Data1=flatten(show), Data2=flatten(length_line_2), Data3=flatten(length_line))
solver = Solver(
    GoalObjects=merge_3,
    Reset=Button(),
    Restart=False,
    Parallel=True,
    Threshold=1e-15,
    Tolerance=0.01,
    AddCurrent=False,
    On=Toggle(True))  # -> V, O
lng = ListLength(List=merge_2)  # -> expr("x-1", Length)
subset = SubList(List=solver.O, Domain=lng, Wrap=True)  # -> List, Index
split = SplitList(List=subset.List, Index=Slider(5, range=0..10))  # -> ListA, ListB
pipe = Pipe(Curve=split.ListB, Radius=Slider(0.046, range=0..1), Caps=0)
preview = CustomPreview(Geometry=pipe, Shader=ColourSwatch(SwatchColor=RGB(255, 56, 56)))
preview_2 = CustomPreview(Geometry=split.ListA, Shader=ColourSwatch(SwatchColor=RGB(0, 0, 0)))

# ---- group: Parameters
anchors_count = Slider(30, range=0..1000)

# ---- group: Bar_lines
item = ListItem(List=split.ListB, Index=0, Wrap=True)
item_2 = ListItem(List=split.ListB, Index=1, Wrap=True)
item_3 = ListItem(List=split.ListB, Index=2, Wrap=True)

# ---- group: Input Curves
# Gradient
curve = Curve(item)
# - Defines a gradient for the selection of
# anchors from an initial list.
# - Min % value defines how sparse the
# center is.
# - Number of sections defines in how many
#  percentage groups are you spliting your
# gradient.
# - The shift moves the gradient along the
# curve.
curve_2 = Curve(item_2)

curve_3 = Curve(item)
curve_4 = Curve(item_3)

curve_5 = Curve(item_2)
curve_6 = Curve(item_3)

# ----
list_item = ListItem(List=split.ListA, Index=0, Wrap=True)  # -> Item, Item1, Item2, Item3, Item4
curve_7 = Curve(list_item.Item2)
curve_8 = Curve(list_item.Item3)
curve_9 = Curve(list_item.Item4)
# Get planes for orientation
curve_10 = Curve(list_item.Item)
explode_3 = Explode(Curve=curve_10, Recursive=True)  # -> Segments, Vertices
end_points = EndPoints(Curve=curve_7)  # -> Start, End
end_points_2 = EndPoints(Curve=curve_8)  # -> Start, End
end_points_3 = EndPoints(Curve=curve_9)  # -> Start, End
list_item_2 = ListItem(List=explode_3.Vertices, Index=0, Wrap=True)  # -> Item, Item1, Item2
point = Point(list_item_2.Item1)
point_2 = Point(list_item_2.Item2)
point_3 = Point(list_item_2.Item)

plane_3pt = Plane3Pt(PointA=end_points.Start, PointB=end_points.End, PointC=point)

plane_3pt_2 = Plane3Pt(PointA=end_points_3.Start, PointB=end_points_3.End, PointC=point_3)

plane_3pt_3 = Plane3Pt(PointA=end_points_2.Start, PointB=end_points_2.End, PointC=point_2)

# ----
# place bars
xy_plane = XYPlane(Origin=Point(0, 0, 0))
deconstruct_plane = DeconstructPlane(Plane=xy_plane)  # -> Origin, XAxis, YAxis, ZAxis
amplitude = Amplitude(Vector=deconstruct_plane.YAxis, Amplitude=Slider(-1, range=-12..0))
construct_plane = ConstructPlane(Origin=Point(0, 0, 0), XAxis=amplitude, YAxis=deconstruct_plane.XAxis)

shift_list_to_move_along_curve = Slider(3, range=0..40)
min_value = Slider(0.4, range=0..1)
number_of_sections_defines_the_gradient = Slider(34, range=0..40)  # "Number of Sections (defines the gradient resolution)"
divide_curve = DivideCurve(Curve=curve, Count=anchors_count, Kinks=False)  # -> simplify(Points), Tangents, Parameters
divide_curve_2 = DivideCurve(Curve=curve_2, Count=anchors_count, Kinks=False)  # -> simplify(Points), Tangents, Parameters

# ---- group: Creates the secList
construct_domain = ConstructDomain(DomainStart=1, DomainEnd=min_value)
range = Range(Domain=construct_domain, Steps=number_of_sections_defines_the_gradient)
reverse_list = ReverseList(List=range)
cull_index = CullIndex(List=reverse_list, Indices=0, Wrap=True)
merge_4 = Merge(Data1=range, Data2=cull_index)  # -> flatten(Result)
shift_list = ShiftList(List=merge_4, Shift=shift_list_to_move_along_curve, Wrap=True)

# ----
divide_curve_3 = DivideCurve(Curve=curve_3, Count=anchors_count, Kinks=False)  # -> simplify(Points), Tangents, Parameters
divide_curve_4 = DivideCurve(Curve=curve_4, Count=anchors_count, Kinks=False)  # -> simplify(Points), Tangents, Parameters
c__gradientanchorselection = CSharpScript(initPointsA=divide_curve_3.Points, initPointsB=divide_curve_4.Points, secList=shift_list)  # -> out, oSelectedIndicesA, oSelectedPointsA, oSelectedIndicesB, oSelectedPointsB; inputs initPointsA: list of Point3d, initPointsB: list of Point3d, secList: list of Double
# ---------- c__gradientanchorselection: C# usings ----------
using System.IO;
using System.Text.RegularExpressions;
using System.Linq;
# ---------- c__gradientanchorselection: C# ----------
    //___________ This script selects two lists of points based on a gradient list defined by the user_________
    //___________ re_duque_11/04/22___________________________________________________________________________


    double numPoints = initPointsA.Count(); //total number of points in initPoints
    double numSection = secList.Count(); // total number of sections (gradient resolution)
    List<int> SelectedPointsIndicesA = new List<int>();
    List<Point3d> SelectedPointsA = new List<Point3d>();
    List<int> SelectedPointsIndicesB = new List<int>();
    List<Point3d> SelectedPointsB = new List<Point3d>();
    int i = 0;

    Print("numSection=" + numSection.ToString());

    while (i < numPoints) // go through the list until reaches its end without defining the step size
    {

      Print("i=" + i.ToString());

      // add the i to the list
      SelectedPointsA.Add(initPointsA[i]); //adds current Point in A
      SelectedPointsIndicesA.Add(i); // adds current index in A
      SelectedPointsB.Add(initPointsB[i]); //adds current Point in B
      SelectedPointsIndicesB.Add(i); // adds current index in B

      // which section are we in? Remap the indexes to their respective sections
      int mySection = (int) Math.Floor(i / numPoints * numSection); // i/numPoints gives the relative position of the index in the list. (Math.Floor rounds down the number)

      Print("mySection=" + mySection.ToString());

      //what is the section density? calculate the skip factor: Density/1
      int skip = (int) Math.Round(1 / secList[mySection]); // secList[mySection] gives the skip value based on the list you defined with the densitity ratios

      // gets i value

      i = i + skip;


    }


    oSelectedPointsA = SelectedPointsA;
    oSelectedIndicesA = SelectedPointsIndicesA;

    oSelectedPointsB = SelectedPointsB;
    oSelectedIndicesB = SelectedPointsIndicesB;
# ---------- end c__gradientanchorselection ----------

divide_curve_5 = DivideCurve(Curve=curve_5, Count=anchors_count, Kinks=False)  # -> simplify(Points), Tangents, Parameters
divide_curve_6 = DivideCurve(Curve=curve_6, Count=anchors_count, Kinks=False)  # -> simplify(Points), Tangents, Parameters
c__gradientanchorselection_2 = CSharpScript(initPointsA=divide_curve_5.Points, initPointsB=divide_curve_6.Points, secList=shift_list)  # -> out, oSelectedIndicesA, oSelectedPointsA, oSelectedIndicesB, oSelectedPointsB; inputs initPointsA: list of Point3d, initPointsB: list of Point3d, secList: list of Double; same code as c__gradientanchorselection

c__gradientanchorselection_3 = CSharpScript(initPointsA=divide_curve.Points, initPointsB=divide_curve_2.Points, secList=shift_list)  # -> out, oSelectedIndicesA, oSelectedPointsA, oSelectedIndicesB, oSelectedPointsB; inputs initPointsA: list of Point3d, initPointsB: list of Point3d, secList: list of Double; same code as c__gradientanchorselection

pt = Point(c__gradientanchorselection_3.oSelectedPointsA)
crv = Curve(item)

pt_2 = Point(c__gradientanchorselection.oSelectedPointsB)
crv_2 = Curve(item_3)

pt_3 = Point(c__gradientanchorselection_2.oSelectedPointsA)
curve_11 = Curve(item_2)

pln = Plane(plane_3pt)
pt_4 = Point(pt)
curve_12 = Curve(crv)

pln_2 = Plane(plane_3pt_3)
curve_13 = Curve(curve_11)
pt_5 = Point(pt_3)

pln_3 = Plane(plane_3pt_2)
curve_14 = Curve(crv_2)
pt_6 = Point(pt_2)

len_2 = Length(Curve=curve)
# generate bar shape
pt_7 = Point(Point(0, 0, 0))
pt_8 = ConstructPoint(XCoordinate=len_2, YCoordinate=0, ZCoordinate=0)
ln_3 = Line(StartPoint=pt_7, EndPoint=pt_8)

# ---- group: Input Curves
curve_15 = Curve(ln_3)
curve_16 = Curve(item_2)

# ----
divide_curve_7 = DivideCurve(Curve=curve_15, Count=anchors_count, Kinks=False)  # -> simplify(Points), Tangents, Parameters
divide_curve_8 = DivideCurve(Curve=curve_16, Count=anchors_count, Kinks=False)  # -> simplify(Points), Tangents, Parameters
c__gradientanchorselection_4 = CSharpScript(initPointsA=divide_curve_7.Points, initPointsB=divide_curve_8.Points, secList=shift_list)  # -> out, oSelectedIndicesA, oSelectedPointsA, oSelectedIndicesB, oSelectedPointsB; inputs initPointsA: list of Point3d, initPointsB: list of Point3d, secList: list of Double; same code as c__gradientanchorselection

# ---- group: division_points
pt_9 = Point(c__gradientanchorselection_4.oSelectedPointsA)

# ----
origin_pt = Point(point_3)

plane_normal = PlaneNormal(Origin=pln, ZAxis=Vector(0, 0, 1))
offset_curve = OffsetCurve(Curve=curve_12, Distance=1, Plane=plane_normal, Corners=1)
extend_curve = ExtendCurve(Curve=offset_curve, Type=0, Start=expr("0.5*X", 1), End=expr("0.5*X", 1))
curve_closest_point = CurveClosestPoint(Point=pt_4, Curve=extend_curve)  # -> Point, Parameter, Distance
line = Line(StartPoint=pt_4, EndPoint=curve_closest_point.Point)
list_item_3 = ListItem(List=line, Index=0, Wrap=True)
extrude_along = ExtrudeAlong(Base=curve_12, Curve=list_item_3)
deconstruct_plane_2 = DeconstructPlane(Plane=extrude_along)  # -> Origin, XAxis, YAxis, ZAxis
amplitude_2 = Amplitude(Vector=deconstruct_plane_2.YAxis, Amplitude=Slider(-1, range=-12..0))
construct_plane_2 = ConstructPlane(Origin=origin_pt, XAxis=deconstruct_plane_2.XAxis, YAxis=amplitude_2)

pln_4 = Plane(construct_plane_2)

origin_pt_2 = Point(point)

plane_normal_2 = PlaneNormal(Origin=pln_2, ZAxis=Vector(0, 0, 1))
offset_curve_2 = OffsetCurve(Curve=curve_13, Distance=1, Plane=plane_normal_2, Corners=1)
extend_curve_2 = ExtendCurve(Curve=offset_curve_2, Type=0, Start=expr("0.5*X", 1), End=expr("0.5*X", 1))
curve_closest_point_2 = CurveClosestPoint(Point=pt_5, Curve=extend_curve_2)  # -> Point, Parameter, Distance
line_2 = Line(StartPoint=pt_5, EndPoint=curve_closest_point_2.Point)
list_item_4 = ListItem(List=line_2, Index=0, Wrap=True)
extrude_along_2 = ExtrudeAlong(Base=curve_13, Curve=list_item_4)
deconstruct_plane_3 = DeconstructPlane(Plane=extrude_along_2)  # -> Origin, XAxis, YAxis, ZAxis
amplitude_3 = Amplitude(Vector=deconstruct_plane_3.XAxis, Amplitude=Slider(-1, range=-12..0))
construct_plane_3 = ConstructPlane(Origin=origin_pt_2, XAxis=amplitude_3, YAxis=deconstruct_plane_3.YAxis)

pln_5 = Plane(construct_plane_3)

origin_pt_3 = Point(point_2)

plane_normal_3 = PlaneNormal(Origin=pln_3, ZAxis=Vector(0, 0, 1))
offset_curve_3 = OffsetCurve(Curve=curve_14, Distance=1, Plane=plane_normal_3, Corners=1)
extend_curve_3 = ExtendCurve(Curve=offset_curve_3, Type=0, Start=expr("0.5*X", 1), End=expr("0.5*X", 1))
curve_closest_point_3 = CurveClosestPoint(Point=pt_6, Curve=extend_curve_3)  # -> Point, Parameter, Distance
line_3 = Line(StartPoint=pt_6, EndPoint=curve_closest_point_3.Point)
list_item_5 = ListItem(List=line_3, Index=0, Wrap=True)
extrude_along_3 = ExtrudeAlong(Base=curve_14, Curve=list_item_5)
deconstruct_plane_4 = DeconstructPlane(Plane=extrude_along_3)  # -> Origin, XAxis, YAxis, ZAxis
amplitude_4 = Amplitude(Vector=deconstruct_plane_4.YAxis, Amplitude=Slider(-1, range=-12..0))
construct_plane_4 = ConstructPlane(Origin=origin_pt_3, XAxis=deconstruct_plane_4.XAxis, YAxis=amplitude_4)

pln_6 = Plane(construct_plane_4)

box1_depth = Slider(0.02, range=0..0.1)
box2_depth = Slider(0.02, range=0..0.1)
box1_width = Slider(0.05, range=0..0.1)
box2_width = Slider(0.03, range=0..0.1)
thickness = Slider(0.08, range=0..0.1)
division = Division(A=thickness, B=2)
division_2 = Division(A=box1_width, B=2)
division_3 = Division(A=box2_width, B=2)
addition = Addition(A=box1_depth, B=box2_depth)
dom = ConstructDomain(DomainStart=expr("-x", division_2), DomainEnd=division_2)
dom_2 = ConstructDomain(DomainStart=0, DomainEnd=expr("-X", box1_depth))
dom_3 = ConstructDomain(DomainStart=expr("-x", division_3), DomainEnd=division_3)
dom_4 = ConstructDomain(DomainStart=expr("-x", box1_depth), DomainEnd=expr("-X", addition))
item_4 = ListItem(List=pt_9, Index=0, Wrap=True)
yz = YZPlane(Origin=item_4)
division_4 = Division(A=division, B=2)
offset = OffsetCurve(Curve=curve_15, Distance=expr("-X", division), Corners=1)
rectangle = Rectangle(Plane=yz, XSize=dom_2, YSize=division_4, Radius=0)  # -> Rectangle, Length
offset_2 = OffsetCurve(Curve=curve_15, Distance=division, Corners=1)
rectangle_2 = Rectangle(Plane=pt_9, XSize=dom_3, YSize=dom_4, Radius=0)  # -> Rectangle, Length
rectangle_3 = Rectangle(Plane=pt_9, XSize=dom, YSize=dom_2, Radius=0)  # -> Rectangle, Length
Z_2 = UnitZ(Factor=division_4)
move_2 = Move(Geometry=rectangle.Rectangle, Motion=Z_2)  # -> Geometry, Transform
loft = Loft(
    Curves=[offset, offset_2],
    Options={Adjust=False, Closed=False, LoftEnds=0, LoftSimp=0, LoftType=0, Rebuild=10, Refit=0.01})
Z_3 = UnitZ(Factor=thickness)
boundary = BoundarySurfaces(Edges=[rectangle_3.Rectangle, rectangle_2.Rectangle])
Z_4 = UnitZ(Factor=division)
extr = Extrude(Base=flatten(boundary), Direction=Z_3)
extr_2 = Extrude(Base=loft, Direction=Z_3)
move_3 = Move(Geometry=extr, Motion=expr("-x", Z_4))  # -> Geometry, Transform
move_4 = Move(Geometry=extr_2, Motion=expr("-x", Z_4))  # -> Geometry, Transform

# ---- group: uniform_hook
extrcrv = ExtrudeAlong(Base=move_2.Geometry, Curve=offset)

# ---- group: cubic_bar
brep = Brep(move_4.Geometry)

# ---- group: finger_hooks
brep_2 = Brep(move_3.Geometry)

# ----
sdiff = SolidDifference(BrepsA=brep, BrepsB=brep_2)

lng_2 = ListLength(List=pt_9)
division_5 = Division(A=lng_2, B=2)
item_5 = ListItem(List=pt_9, Index=expr("x-1", division_5), Wrap=True)
item_6 = ListItem(List=pt_9, Index=expr("x-1", lng_2), Wrap=True)
item_7 = ListItem(List=pt_9, Index=0, Wrap=True)
item_8 = ListItem(List=pt_9, Index=expr("x-2", lng_2), Wrap=True)
item_9 = ListItem(List=pt_9, Index=1, Wrap=True)
item_10 = ListItem(List=pt_9, Index=division_5, Wrap=True)
ln_4 = Line(StartPoint=item_8, EndPoint=item_6)
ln_5 = Line(StartPoint=item_5, EndPoint=item_10)
ln_6 = Line(StartPoint=item_7, EndPoint=item_9)
num = Number(division_2)
ext = ExtendCurve(Curve=ln_4, Type=0, Start=num, End=num)
ext_2 = ExtendCurve(Curve=ln_5, Type=0, Start=num, End=num)
yz_2 = YZPlane(Origin=[item_8, item_5, item_7])
ext_3 = ExtendCurve(Curve=ln_6, Type=0, Start=num, End=num)
rectangle_4 = Rectangle(Plane=yz_2, XSize=dom_2, YSize=division_4, Radius=0)  # -> Rectangle, Length
move_5 = Move(Geometry=rectangle_4.Rectangle, Motion=expr("-2*x", Z_2))  # -> Geometry, Transform
item_11 = ListItem(List=move_5.Geometry, Index=0, Wrap=True)  # -> Item, Item1, Item2
srf = Surface(item_11.Item)
srf_2 = Surface(item_11.Item1)
srf_3 = Surface(item_11.Item2)
X = UnitX(Factor=num)

# ---- group: mid_hook
extrcrv_2 = ExtrudeAlong(Base=srf_2, Curve=ext_2)

# ---- group: far_end_hook
extrcrv_3 = ExtrudeAlong(Base=srf, Curve=ext)

# ---- group: start_end_hook
extrcrv_4 = ExtrudeAlong(Base=srf_3, Curve=ext_3)

# ----
move_6 = Move(Geometry=[extrcrv_3, extrcrv_2, extrcrv_4], Motion=expr("-x", X))  # -> Geometry, Transform

# ----
# bar_prototype
sdiff_2 = SolidDifference(BrepsA=sdiff, BrepsB=[move_6.Geometry, extrcrv])

brep_3 = Brep(sdiff_2)
orient = Orient(Geometry=brep_3, Source=construct_plane, Target=pln_4)  # -> Geometry, Transform
orient_2 = Orient(Geometry=brep_3, Source=construct_plane, Target=pln_6)  # -> Geometry, Transform
orient_3 = Orient(Geometry=brep_3, Source=construct_plane, Target=pln_5)  # -> Geometry, Transform

scale = Scale(Geometry=sdiff_2, Center=Point(0, 0, 0), Factor=Slider(1000, range=0..1000))  # -> Geometry, Transform
# milling path
brep_4 = Brep(scale.Geometry)
